# Grasshopper definition constructivo2.gh (Grasshopper 0.9.70)

mesh = Mesh(<mesh referenced from the Rhino model>)
brep = Brep(<brep referenced from the Rhino model>)

xz = XZPlane(Origin=Point(0, 0, 0))
mshadow = MeshShadow(Mesh=mesh, Light=xz, Plane=PlaneXY(0, 0, 0))

xz_2 = XZPlane(Origin=Point(0, 0, 0))
mshadow_2 = MeshShadow(Mesh=mesh, Light=Vector(0, 0, -1), Plane=xz_2)

visible_cork_rail = Slider(19.1, range=0..40)
xy = XYPlane(Origin=Point(0, 0, 0))
offset = Offset(Curve=mshadow_2, Distance=visible_cork_rail, Plane=xy, Corners=1)

solid_cork_rail = Slider(25, range=0..40)
xy_2 = XYPlane(Origin=Point(0, 0, 0))
offset_2 = Offset(Curve=mshadow_2, Distance=solid_cork_rail, Plane=xy_2, Corners=1)

security_xy_margins = Slider(-3, range=-3..-2)
xy_3 = XYPlane(Origin=Point(0, 0, 0))
offset_3 = Offset(Curve=mshadow_2, Distance=security_xy_margins, Plane=xy_3, Corners=1)

security_xy_margins_2 = Slider(2, range=2..3)
xy_4 = XYPlane(Origin=Point(0, 0, 0))
offset_4 = Offset(Curve=mshadow, Distance=security_xy_margins_2, Plane=xy_4, Corners=1)

Y = UnitY(Factor=Slider(1000, range=1000..1001))
extr = Extrude(Base=offset_4, Direction=Y)

Z = UnitZ(Factor=Slider(1000, range=1000..1001))
extr_2 = Extrude(Base=offset, Direction=Z)

Z_2 = UnitZ(Factor=Slider(1000, range=1000..1001))
extr_3 = Extrude(Base=offset_3, Direction=Z_2)

Z_3 = UnitZ(Factor=Slider(1000, range=1000..1001))
extr_4 = Extrude(Base=offset_2, Direction=Z_3)

sdiff = SolidDifference(BrepsA=brep, BrepsB=extr)
msplit = MeshSplit(Mesh=mesh, Splitters=extr_2)

split = SplitBrep(Brep=brep, Cutter=extr_4)
split_2 = SplitBrep(Brep=sdiff, Cutter=extr_3)

dispatch = Dispatch(List=msplit, DispatchPattern=[True, False])  # -> ListA, ListB
decks = Mesh(dispatch.ListB)

disjoint = DisjointMesh(Mesh=decks)
dispatch_2 = Dispatch(List=disjoint, DispatchPattern=[True, False])  # -> ListA, ListB
bottom = Mesh(dispatch_2.ListA)
top = Mesh(dispatch_2.ListB)

top_tickness = Slider(-3.3, range=-5..1)
bottom_tickness = Slider(1.8, range=1..5)
Z_4 = UnitZ(Factor=bottom_tickness)
Z_5 = UnitZ(Factor=top_tickness)

move = Move(Geometry=bottom, Motion=Z_4)  # -> Geometry, Transform
move_2 = Move(Geometry=top, Motion=Z_5)  # -> Geometry, Transform
rail = Mesh(dispatch.ListA)
