# Grasshopper definition constructivo2_b.gh (Grasshopper 0.9.70)

mesh = Mesh(<mesh referenced from the Rhino model>)
xy = XYPlane(Origin=Point(0, 0, 0))
pln = Plane(xy)
xz = XZPlane(Origin=Point(0, 0, 0))
altura_m_axima_incluido_rocker = Slider(700, range=0..1000)
mshadow = MeshShadow(Mesh=mesh, Light=Vector(0, 0, -1), Plane=pln)
mshadow_2 = MeshShadow(Mesh=mesh, Light=xz, Plane=PlaneXY(0, 0, 0))
crv = Curve(mshadow)
Z = UnitZ(Factor=altura_m_axima_incluido_rocker)
extr = Extrude(Base=crv, Direction=Z)
cap = CapHoles(Brep=extr)

Y = UnitY(Factor=1)
project = Project(Curve=mshadow_2, Brep=cap, Direction=Y)
Y_2 = UnitY(Factor=Slider(889, range=-2001..2000))
move = Move(Motion=Y_2)  # -> Geometry, Transform
Y_3 = UnitY(Factor=Slider(593, range=-2001..2000))
move_2 = Move(Motion=Y_3)  # -> Geometry, Transform
move_3 = Move(Motion=Y_3)  # -> Geometry, Transform; disabled
move_4 = Move(Geometry=project, Motion=Y_3)  # -> Geometry, Transform
dispatch = Dispatch(DispatchPattern=[True, False])  # -> ListA, ListB
join = JoinCurves(Curves=dispatch.ListB, Preserve=False)
Y_4 = UnitY(Factor=Slider(425, range=0..1000))
extr_2 = Extrude(Base=dispatch.ListB, Direction=Y_4)
capex = CapHolesEx(Brep=extr_2)  # -> Brep, Caps, Solid
